# Grasshopper definition Hops_gen_random_cubes.gh (Grasshopper 1.0.7)
# plug-ins: Hops

width = Slider(35, range=1..50)
depth = Slider(20, range=1..50)
height = Slider(10, range=1..30)
width_2 = Slider(35, range=1..50)
depth_2 = Slider(20, range=1..50)
height_2 = Slider(10, range=1..30)
concat = Concatenate(FragmentA=width, FragmentB=depth, FragmentC=height, JoinSeparator="_")
concat_2 = Concatenate(FragmentA=width_2, FragmentB=depth_2, FragmentC=height_2, JoinSeparator="_")
hops = Hops(
    Boolean=Toggle(True),
    Nr_vol=Slider(2, range=1..3),
    Vol_dim=concat,
    Boundary_dimms=concat_2,
    Map="./data/dummy_map.np",
    CacheResultsInMemory=False,
    CacheSolveResults=False,
    RemoteDefinitionLocation="http://127.0.0.1:5478/gen_random_cubes",
    RemoteSolveVersion=(0, 1, 0),
    ShowInput_Enabled=False,
    ShowInput_Path=False,
    SynchronousSolve=True)  # -> Info, Box_prev, Vox_idx
panel = Panel(hops.Info)
